# Grasshopper definition curve decomposition.ghx (Grasshopper 0.9.14)
# plug-ins: Decodes Python Interpreter

pt = Point([<point referenced from the Rhino model> x5])
decodes = DecodesPythonScript(pts_in=pt)  # -> console, a; inputs pts_in: list
# ---------- decodes: Python ----------
x_m = 0
y_m = 0
xsq_m = 0
xy_m = 0


for pt in pts_in :
    x_m = x_m + pt.x 
    y_m = y_m + pt.y
    xsq_m = xsq_m + pt.x*pt.x
    xy_m = xy_m + pt.x*pt.y
    
N = len(pts_in)
x_m = x_m/N
y_m = y_m/N
xsq_m = xsq_m/N
xy_m = xy_m/N

if (xsq_m != x_m*x_m):
    m = (xy_m - x_m*y_m)/(xsq_m - x_m*x_m)
    y_coeff = y_m - m*x_m
    p_ls = Point(0, y_coeff)
    u_ls = Vec(1, m).normalized()
    
d_min = 0
d_max = 0
for pt in pts_in:
    d = Vec(pt - p_ls).dot(u_ls)
    if (d > d_max): d_max = d
    elif (d < d_min): d_min = d

p_start = p_ls + u_ls*d_min
p_end = p_ls + u_ls*d_max

line_lsq = Segment(p_start, p_end)
a.put(line_lsq)
# ---------- end decodes ----------
decodes_2 = DecodesPythonScript()  # -> console, a, b
# ---------- decodes_2: Python ----------
import math

pts_in = []

for i in range(10):
    pts_in.append(Point(10*math.cos(1.2*math.pi*i/10), 4*math.sin(1.2*math.pi*i/10)))
    
a.put(pts_in)

x_m = 0
y_m = 0
xsq_m = 0
xy_m = 0

for pt in pts_in :
    x_m = x_m + pt.x 
    y_m = y_m + pt.y
    xsq_m = xsq_m + pt.x*pt.x
    xy_m = xy_m + pt.x*pt.y
    
N = len(pts_in)
x_m = x_m/N
y_m = y_m/N
xsq_m = xsq_m/N
xy_m = xy_m/N

if (xsq_m != x_m*x_m):
    m = (xy_m - x_m*y_m)/(xsq_m - x_m*x_m)
    y_coeff = y_m - m*x_m
    p_ls = Point(0, y_coeff)
    u_ls = Vec(1, m).normalized()
    
d_min = 0
d_max = 0
for pt in pts_in:
    d = Vec(pt - p_ls).dot(u_ls)
    if (d > d_max): d_max = d
    elif (d < d_min): d_min = d

p_start = p_ls + u_ls*d_min
p_end = p_ls + u_ls*d_max

line_lsq = Segment(p_start, p_end)
b.put(line_lsq)
# ---------- end decodes_2 ----------
panel = Panel(decodes.a)
