# Grasshopper definition great court roof.ghx (Grasshopper 0.9.14)
# plug-ins: Decodes Python Interpreter

rec_w = Slider(4.2, range=1..8)
rec_h = Slider(6.8, range=1..8)
rad = Slider(1, range=0.1..3)
height = Slider(0.6, range=-1..1.5)
inner_rad = Slider(0.81, range=0..1)
outer_rad = Slider(3.6, range=1..4)
height_2 = Slider(1, range=0..1.5)
panel = Panel("Circle")
decodes = DecodesPythonScript(rad=rad)  # -> console, a
# ---------- decodes: Python ----------
import math

def func(t):
    c = math.cos(t)
    s = math.sin(t)
    pt_out = Point(rad*c, rad*s)
    return pt_out
     

a.put(func)
# ---------- end decodes ----------
# Rectangular curve parametrized by even intervals along boundary TODO, show potential problems with this
decodes_2 = DecodesPythonScript(rec_w=rec_w, rec_h=rec_h)  # -> console, a; disabled
# ---------- decodes_2: Python ----------
def func(t):
    if (t>=0) and (t<0.25): 
        ln = Line( Point(-rec_w/2,-rec_h/2), Point(rec_w/2,-rec_h/2) )
        pt_out = ln.eval(t*4.0)
    elif (t>=0.25) and (t<0.5): 
        ln = Line( Point(rec_w/2,-rec_h/2), Point(rec_w/2,rec_h/2) )
        pt_out = ln.eval((t-0.25)*4.0)
    elif (t>=0.5) and (t<0.75): 
        ln = Line( Point(rec_w/2,rec_h/2), Point(-rec_w/2,rec_h/2) )
        pt_out = ln.eval((t-0.5)*4.0)
    elif (t>=0.75) and (t<=1.0): 
        ln = Line( Point(-rec_w/2,rec_h/2), Point(-rec_w/2,-rec_h/2) )
        pt_out = ln.eval((t-0.75)*4.0)
    else: print "wtf?"
      
    return pt_out
    

#a.put(func)


crv = Curve(func,Interval(0,1))
a.put(crv)
# ---------- end decodes_2 ----------
# This approach is generalizable to any two curves defined with polar geometry (i.e. where t refers to the sweep angle).  Here is an example:
decodes_3 = DecodesPythonScript(rad=inner_rad)  # -> console, a
# ---------- decodes_3: Python ----------
import math

def func(t):
    c = math.cos(t)
    s = math.sin(t)
    pt_out = Point(rad*abs(c)*c, rad*abs(s)*s)
    return pt_out     

a.put(func)
# ---------- end decodes_3 ----------
decodes_4 = DecodesPythonScript(rad=outer_rad)  # -> console, a
# ---------- decodes_4: Python ----------
import math

def func(t):
    c = math.cos(t)
    s = math.sin(t)
    factor1 = 0.1
    factor2 = 0.5
    r = rad*(1 + factor1*math.cos(2*t) + factor2*math.cos(3*t))
    pt_out = Point(r*c, r*s)
    return pt_out
     
#crv = Curve(func, Interval(0, 2*math.pi), 0.01)
#a.put(crv)
a.put(func)
# ---------- end decodes_4 ----------
# Creating a (flat) surface function in (u,v) where u = "t" (angle) and v = "m" (tweening parameter)
decodes_5 = DecodesPythonScript(rec_w=rec_w, rec_h=rec_h, rad=rad)  # -> console, a, domain
# ---------- decodes_5: Python ----------
import math


def func1(t):
    c = math.cos(t)
    s = math.sin(t)
    #pt_out = Point(0.5*abs(c)*rad*c, abs(s)*rad*s)
    pt_out = Point(rad*c, rad*s)
    return pt_out
     
def func2(t):
    c = math.cos(t)
    s = math.sin(t)
    alpha = math.atan(rec_h/rec_w)
    pi = math.pi
    pi_over_2 = 0.5*pi
    
    if (t >=0) and (t < alpha):
        l_coord = 0.5*rec_w*s/c
        pt_out = Point(rec_w/2, l_coord)
    elif (t >= alpha) and (t < pi-alpha):
        l_coord = 0.5*rec_h*c/s
        pt_out = Point(l_coord, rec_h/2)
    elif (t >= pi-alpha) and (t < pi + alpha):
        l_coord = -0.5*rec_w*s/c
        pt_out = Point(-rec_w/2, l_coord)
    elif (t >= pi + alpha) and (t < 2*pi - alpha):
        l_coord = -0.5*rec_h*c/s
        pt_out = Point(l_coord, -rec_h/2) 
    elif (t >= 2*pi-alpha) and (t <= 2*pi):
        l_coord = 0.5*rec_w*s/c
        pt_out = Point(rec_w/2, l_coord)
    else:
        print "Out-of-bounds!"
   
    return pt_out
    
def func(u,v):
    return func1(u)*(1-v) + func2(u)*v
      

a.put(func)

domain.put([0,2*math.pi, 0, 1])
# ---------- end decodes_5 ----------
# Introducing height (needs to be expressed as a function of u and v)
# TODO - nothing special about symmetry.  Do an example where circle remains in place but rectangle is offset
decodes_6 = DecodesPythonScript(rec_w=rec_w, rec_h=rec_h, rad=rad, height=height)  # -> console, a, domain
# ---------- decodes_6: Python ----------
import math


def func1(t):
    c = math.cos(t)
    s = math.sin(t)
    pt_out = Point(rad*c, rad*s)
    return pt_out
     
def func2(t):
    c = math.cos(t)
    s = math.sin(t)
    alpha = math.atan(rec_h/rec_w)
    pi = math.pi
    pi_over_2 = 0.5*pi
    
    if (t >=0) and (t < alpha):
        l_coord = 0.5*rec_w*s/c
        pt_out = Point(rec_w/2, l_coord)
    elif (t >= alpha) and (t < pi-alpha):
        l_coord = 0.5*rec_h*c/s
        pt_out = Point(l_coord, rec_h/2)
    elif (t >= pi-alpha) and (t < pi + alpha):
        l_coord = -0.5*rec_w*s/c
        pt_out = Point(-rec_w/2, l_coord)
    elif (t >= pi + alpha) and (t < 2*pi - alpha):
        l_coord = -0.5*rec_h*c/s
        pt_out = Point(l_coord, -rec_h/2) 
    elif (t >= 2*pi-alpha) and (t <= 2*pi):
        l_coord = 0.5*rec_w*s/c
        pt_out = Point(rec_w/2, l_coord)
    else:
        print "Out-of-bounds!"   
    return pt_out
    
def func(u,v):
    pt_out = func1(u)*(1-v) + func2(u)*v 
    pt_out.z = math.sin(v*math.pi)*height
    return pt_out
      

print func(1.0,0.5)


a.put(func)
domain.put([0,2*math.pi, 0, 1])
# ---------- end decodes_6 ----------
# Rectangle parametrized as a function of the sweep angle
decodes_7 = DecodesPythonScript(rec_w=rec_w, rec_h=rec_h)  # -> console, a
# ---------- decodes_7: Python ----------
import math


def func(t):
    c = math.cos(t)
    s = math.sin(t)
    alpha = math.atan(rec_h/rec_w)
    pi = math.pi
    pi_over_2 = 0.5*pi
    
    if (t >=0) and (t < alpha):
        l_coord = 0.5*rec_w*s/c
        pt_out = Point(rec_w/2, l_coord)
    elif (t >= alpha) and (t < pi-alpha):
        l_coord = 0.5*rec_h*c/s
        pt_out = Point(l_coord, rec_h/2)
    elif (t >= pi-alpha) and (t < pi + alpha):
        l_coord = -0.5*rec_w*s/c
        pt_out = Point(-rec_w/2, l_coord)
    elif (t >= pi + alpha) and (t < 2*pi - alpha):
        l_coord = -0.5*rec_h*c/s
        pt_out = Point(l_coord, -rec_h/2) 
    elif (t >= 2*pi-alpha) and (t <= 2*pi):
        l_coord = 0.5*rec_w*s/c
        pt_out = Point(rec_w/2, l_coord)
    else:
        print "Out-of-bounds!"
   
    return pt_out
     

a.put(func)
# ---------- end decodes_7 ----------
decodes_8 = DecodesPythonScript(func1=decodes_3.a, func2=decodes_4.a, height=height_2)  # -> console, a, domain
# ---------- decodes_8: Python ----------
import math

    
def func(u,v):
    pt_out = func1(u)*(1-v) + func2(u)*v 
    pt_out.z = math.sin(v*math.pi)*height
    return pt_out
      
a.put(func)
domain.put([0,2*math.pi, 0, 1])
# ---------- end decodes_8 ----------
res_u = Slider(80, range=4..80)
res_v = Slider(30, range=2..30)
# Tweening for function defined on the domain [0, 2pi]
slider = Slider(0, range=0..1)
decodes_9 = DecodesPythonScript(m=slider, func1=decodes.a, func2=decodes_7.a)  # -> console, a
# ---------- decodes_9: Python ----------
#Interpolates between two curves given by func1 and func2, both defined on [0,2pi]
import math

def func(t):
    return func1(t)*(1-m) + func2(t)*m
      
crv_out = Curve(func,Interval(0, 2*math.pi), 0.01)
a.put(crv_out)
# ---------- end decodes_9 ----------
decodes_10 = DecodesPythonScript(domain=decodes_5.domain, res_u=res_u, res_v=res_v)  # -> console, a; inputs domain: list
# ---------- decodes_10: Python ----------
#IN:   a function f(u,v) describing a parametric surface on the domain [0, 2pi]x[0,1]
#OUT:  Surface expressed as a mesh aligned with isocurves for u, v determined by res_u and res_v 

import math

u0 = domain[0]
u1 = domain[1]
v0 = domain[2]
v1 = domain[3]

count_u = int(res_u)
count_v = int(res_v)
tol_u = (u1-u0)/count_u
tol_v = (v1-v0)/count_v
u_vals = [u0 + i*tol_u for i in range(count_u+1)]
v_vals = [v0 + i*tol_v for i in range(count_v+1)]

#Expressed as a mesh with faces determined by isocurves
msh = Mesh()
for v in v_vals:
    for u in u_vals:
        msh.append(func(u,v))

for j in range(count_v):
    for i in range(count_u):
        index = j*(count_u + 1) + i
        msh.add_face(index,index + 1, index + count_u + 2 , index + count_u + 1)

a.put(msh)
# ---------- end decodes_10 ----------
decodes_11 = DecodesPythonScript(func=decodes_6.a, domain=decodes_6.domain, res_u=res_u, res_v=res_v)  # -> console, a; inputs domain: list
# ---------- decodes_11: Python ----------
#IN:   a function f(u,v) describing a parametric surface on the domain [0,2*pi]x[0,1]
#OUT:  Surface expressed as a mesh, simple triangulation style

u0 = domain[0]
u1 = domain[1]
v0 = domain[2]
v1 = domain[3]

count_u = int(res_u)
count_v = int(res_v)
tol_u = (u1-u0)/res_u
tol_v = (v1-v0)/res_v
u_vals = [u0 + i*tol_u for i in range(count_u+1)]
v_vals = [v0 + i*tol_v for i in range(count_v+1)]


msh = Mesh()
for v in v_vals:
    for u in u_vals:
        msh.append(func(u,v))

for j in range(count_v):
    for i in range(count_u):
        index = j*(count_u + 1) + i
        msh.add_face(index,index + 1, index + count_u + 2)
        msh.add_face(index, index + count_u + 2, index + count_u + 1)

a.put(msh)
# ---------- end decodes_11 ----------
# Quad mesh aligned with isocurves
panel_2 = Panel("Triangluar mesh")
