# Grasshopper definition gh out test.gh (Grasshopper 0.9.14)
# plug-ins: Decodes Python Interpreter

slider = Slider(5, range=0..10)
decodes = DecodesPythonScript()  # -> Out, A
decodes_2 = PythonScript(x=slider)  # -> out, a, b, c
# ---------- decodes_2: Python ----------
pt = Point(1,1,x)
vec = Vec(0,10,x)
seg = Line(Point(1,1,x),Vec(0,0,-2))
cs = CS(Point(-2,-x), Vec(0,2,x))

verts = [
  Point(0.0       , 0.0	      , 0.0),
  Point(0.9510565 , 0.0	      , 0.0),
  Point(0.6881910 , 1.3763819 , 0.0),
  Point(0.5257311 , 0.6881910	, x/2)
]
faces = [[0,1,2],[0,2,3],[2,3,0],[3,0,1]]
mesh = dc.Mesh(verts,faces)

a.put(mesh)
a.put([[pt,pt,pt],[pt,pt,pt]])
a.put(vec)
a.put(10)

b.put(10)
b.put(20)

c.put("sdf")
c.put('d')
# ---------- end decodes_2 ----------
decodes_3 = PythonScript(x=slider)  # -> out, a
# ---------- decodes_3: Python ----------
import decodes.extensions.danzerTile as dt

maxRecursion = 3
def recurse(tiles,rlvl=0):
  if rlvl < maxRecursion : return [recurse(tile.inflate(),rlvl+1) for tile in tiles]
  else : return [tile.draw() for tile in tiles]

a.put( recurse([dt.DzTileK()]) )
# ---------- end decodes_3 ----------
panel = Panel(decodes_2.a)
panel_2 = Panel(decodes_3.out)
panel_3 = Panel(decodes_2.out)
panel_4 = Panel(decodes_2.b)
panel_5 = Panel(decodes_2.c)
