# Grasshopper definition vec field test.gh (Grasshopper 0.9.14)
# plug-ins: Decodes Python Interpreter

md_slider = MDSlider(
    slider_value=Point(0.3859597085, 0.2535730346, 0.5),
    x_domain=Domain(-2, 10),
    y_domain=Domain(-2, 10),
    z_domain=Domain(0, 1),
    SliderMode=0)
pt = Point(md_slider)
decodes = DecodesPythonScript(res=Slider(6, range=0..10), dim=Slider(8.779, range=0..10), s_pt=pt)  # -> console, a, b; inputs res: Int32
# ---------- decodes: Python ----------
vf = VecField(pixel_res=Interval(res,res), spatial_origin=Point(dim/2,dim/4), spatial_dim=Interval(dim,dim/2))

for x in range(vf.px_width):
    for y in range(vf.px_height):
        vf.set(x,y,Vec(x/(y+1),y/(x+1)))


a.put(vf.to_rays())

#print vf.address_near(s_pt)
sample_vec = vf.vec_near(s_pt)
b.put(Ray(s_pt,sample_vec))
# ---------- end decodes ----------
geo = Geometry(decodes.b)
panel = Panel(decodes.console)
