# Grasshopper definition quadtreeclass.gh (Grasshopper 0.9.14)
# plug-ins: Decodes Python Interpreter

md_slider = MDSlider(
    slider_value=Point(0.346341482, 0.2512195866, 0.5),
    x_domain=Domain(0, 5),
    y_domain=Domain(0, 5),
    z_domain=Domain(0, 1),
    SliderMode=0)
slider = Slider(9, range=0..10)
pt = Point(md_slider)
pt_2 = Point(Point(4.370143807, 4.199721879, 0))
decodes = DecodesPythonScript(pt=pt)  # -> console, a
# ---------- decodes: Python ----------
    
rect=Bounds(Point(2.5,2.5),4,4)
a.put(rect.corners)

qt = QuadTree(4, rect)

for n in range(6):
    qt.append(pt)
    print qt.has_children, qt.pts

"""
qt.divide()
for child in qt.children:
    if child.contains(pt): a.put(child.bnd.corners)
"""
# ---------- end decodes ----------
rect_class = DecodesPythonScript(y=pt_2, w2=slider, h2=slider)  # -> console, a, b, c; disabled
# ---------- rect_class: Python ----------
tp = y
rcent = Point(4,3,5)
rectagon = Bounds(rcent, 3, 5) 
rcent2 = y
rectagon2 = Bounds(rcent2, w2, h2)

Answer = rectagon.intersects(rectagon2)
print Answer
a.put(rectagon.corners)
b.put(rectagon2.corners)
# ---------- end rect_class ----------
pline = PolyLine(Vertices=decodes.a, Closed=True)
